# Grasshopper definition BirdFlocking_GH_Simon.gh (Grasshopper 1.0.7)

panel = Panel("C:\Users\simon\Dropbox\ITECH 2018-2019\ComputationalDesign\Assignments\FinalAssignment\CompDesing_Birdflocking\BirdFlocking\BirdFlocking.py")
timer = Timer(TimerInterval=50, Target=python)
file = ReadFile(File=panel, PerLineParse=False)
pt = Point(Point(-4.736130552, -5.634463479, 2.969157409))
python = GhPythonScript(
    Code=file,
    IReset=Button(),
    IEnabled=Toggle(False),
    IAgentCount=Slider(4, range=0..100),
    IFoodStrength=Slider(2.86, range=0..10),
    IFoodSource=pt)  # -> Out, OGeometry, OPositions
